# Grasshopper definition TestConnection.gh (Grasshopper 1.0.7)
# Copyright: 2021
# plug-ins: GrasshopperRadianceLinuxConnector, LadybugGrasshopper

# Run a SSH Command
panel = Panel("""cd ~/simulation
pwd
ls""")
panel_2 = Panel("""oneMeshmaterial
twoMeshesmaterial""")
panel_3 = Panel("""oneMesh
twoMeshes""")
falsestart = LBFalseStartToggle(True)
mesh = Mesh(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)
mesh_2 = Mesh(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)
testconnection = TestConnection()
entwine = Entwine(Branch00=mesh, Branch01=mesh_2, FlattenInputs=True)
graft = GraftTree(Tree=panel_2, IncludeEmptyLists=True, IncludeNullItems=True)
graft_2 = GraftTree(Tree=panel_3, IncludeEmptyLists=True, IncludeNullItems=True)
connect_ssh = ConnectSSH(User="mss", Ip="127.0.0.1", Password="_prompt", _port=22, Connect=Toggle(True))
execute_ssh = ExecuteSSH(SSHCommands=panel, Run=falsestart)
panel_4 = Panel(testconnection)
panel_5 = Panel(connect_ssh)
falsestart_2 = LBFalseStartToggle(True)
panel_6 = Panel(execute_ssh)
gh_meshtorad = GH_MeshToRad(Mesh=entwine, Name=graft_2, ModifierName=graft, LocalWorkingDirectory="C:\Users\mm1013\simulation", Run=falsestart_2)  # -> LocalFilePaths, MappingFilePath
panel_7 = Panel(gh_meshtorad.LocalFilePaths)
panel_8 = Panel(gh_meshtorad.MappingFilePath)
falsestart_3 = LBFalseStartToggle(False)
obj2rad = ObjToRad(
    ObjFilePaths=gh_meshtorad.LocalFilePaths,
    MapFile=gh_meshtorad.MappingFilePath,
    LinuxTargetFolder="~/simulation",
    Run=falsestart_3)  # -> Status, RadFilePaths
